# Grasshopper definition TestProgram.gh (Grasshopper 1.0.8)
# plug-ins: RhinoCodePluginGH

srf = Surface(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)
c_script = CSharpScript(Srf=srf)  # -> out, a; inputs Srf: Surface
# ---------- c_script: C# ----------
// Grasshopper Script Instance
#region Usings
using System;
using System.Linq;
using System.Collections;
using System.Collections.Generic;
using System.Drawing;

#r "D:\研究所\PQMesh\PrincipleCurvatureCrystall_Growth\bin\Debug\net48\PrincipleCurvatureCrystall_Growth.dll"

using Rhino;
using Rhino.Geometry;

using Grasshopper;
using Grasshopper.Kernel;
using Grasshopper.Kernel.Data;
using Grasshopper.Kernel.Types;

using PrincipalCurvatureCrystal_Growth;
using PrincipalCurvatureCrystal_Growth.ThresholdAttribute;

#endregion

public class Script_Instance : GH_ScriptInstance
{
    #region Notes
    /* 
      Members:
        RhinoDoc RhinoDocument
        GH_Document GrasshopperDocument
        IGH_Component Component
        int Iteration

      Methods (Virtual & overridable):
        Print(string text)
        Print(string format, params object[] args)
        Reflect(object obj)
        Reflect(object obj, string method_name)
    */
    #endregion

    private void RunScript(Surface Srf, object y, ref object a)
    {
        // Write your logic here
        var Env = new PrincipalCurvatureCrystal_Growth.Environment(Srf, 10, 10, new List<ThresholdAttributeBase>{new PrincipleCurvatureAttribute()});
        Env.SetStartCrystalPoints(4, 20);
        Env.Run(-0.1);
        a = null;
    }
}
# ---------- end c_script ----------
